# Dynamo graph sampleExportSheets.dyn (Dynamo 0.8.0.950)

byDefault = Utilities.ExportToDXF.ByDefault()
family_types = FamilyTypes("Triangle Rig:Clear")
all_elements_of_family_type = ElementsOfFamilyType(family_types)
family_types_2 = FamilyTypes("Triangle Rig:Solid")
all_elements_of_family_type_2 = ElementsOfFamilyType(family_types_2)
family_types_3 = FamilyTypes("Triangle Rig:Base")
all_elements_of_family_type_3 = ElementsOfFamilyType(family_types_3)
join = List.Join(all_elements_of_family_type, all_elements_of_family_type_2, all_elements_of_family_type_3)
geometry = Element.Geometry(join)
locations = AdaptiveComponent.Locations(join)
element_types = ElementTypes("CurveElement")
all_elements_of_type = ElementsOfType(element_types)
curve = CurveElement.Curve(all_elements_of_type)
select_model_element = DSModelElementSelection()  # 1 picked in the model
point = ReferencePoint.Point(select_model_element)
select_model_elements = DSModelElementsSelection()  # 1 picked in the model
point_2 = ReferencePoint.Point(select_model_elements)
select_model_element_2 = DSModelElementSelection()  # 1 picked in the model
point_3 = ReferencePoint.Point(select_model_element_2)
select_model_element_3 = DSModelElementSelection()  # 1 picked in the model
point_4 = ReferencePoint.Point(select_model_element_3)
select_model_element_4 = DSModelElementSelection()  # 1 picked in the model
point_5 = ReferencePoint.Point(select_model_element_4)
select_model_element_5 = DSModelElementSelection()  # 1 picked in the model
point_6 = ReferencePoint.Point(select_model_element_5)
select_model_element_6 = DSModelElementSelection()  # 1 picked in the model
point_7 = ReferencePoint.Point(select_model_element_6)
select_model_elements_2 = DSModelElementsSelection()  # 1 picked in the model
point_8 = ReferencePoint.Point(select_model_elements_2)
select_model_element_7 = DSModelElementSelection()  # 1 picked in the model
point_9 = ReferencePoint.Point(select_model_element_7)
select_model_element_8 = DSModelElementSelection()  # 1 picked in the model
point_10 = ReferencePoint.Point(select_model_element_8)
select_model_element_9 = DSModelElementSelection()  # 1 picked in the model
point_11 = ReferencePoint.Point(select_model_element_9)
create = List.Create(point, point_2, point_3, point_4, point_5, point_6, point_7, point_8, point_9, point_10, point_11)
byCurvesAndPoints = TriangleRigging.TriangleSpline.ByCurvesAndPoints(curve, create)
getSplines = TriangleRigging.TriangleSpline.GetSplines(byCurvesAndPoints)
bySolidsPointsSplines = TriangleRigging.TriangleRigging.BySolidsPointsSplines(geometry, locations, getSplines)
triangles = TriangleRigging.TriangleRigging.Triangles(bySolidsPointsSplines)
getSortedTriangleIndexByName = TriangleRigging.TriangleRigging.GetSortedTriangleIndexByName(bySolidsPointsSplines)
getItemAtIndex = List.GetItemAtIndex(list=triangles, index=getSortedTriangleIndexByName)
code_block = CodeBlock { inchtoft(1/16); }
getEdgeLabels = TriangleRigging.Triangle.GetEdgeLabels(getItemAtIndex, code_block)
contextCoordinateSystem = TriangleRigging.Triangle.contextCoordinateSystem(getItemAtIndex)
byPolyCurvesAndCS = Fabrication.Sheets.ByPolyCurvesAndCS(getEdgeLabels, contextCoordinateSystem)
getTriangleRowIndexBySpline = TriangleRigging.TriangleRigging.GetTriangleRowIndexBySpline(bySolidsPointsSplines)
number = DoubleInput(3)
count = List.Count(getSplines)
code_block_2 = CodeBlock(input=count) { numRows(input); }
y_spacing = DoubleInput(2)
mul = code_block_2 * y_spacing
getPolyCurveIndexAsRow = Fabrication.Sheets.GetPolyCurveIndexAsRow(byPolyCurvesAndCS, getTriangleRowIndexBySpline, number, mul)
number_2 = DoubleInput(1)
flatten = List.Flatten(list=getPolyCurveIndexAsRow, amt=number_2)
string = StringInput("LABELS")
number_3 = DoubleInput(1)
addPolyCurvesAsArcsLines = Utilities.ExportToDXF.AddPolyCurvesAsArcsLines(byDefault, flatten, string, number_3)
perimeterCurves = TriangleRigging.Triangle.PerimeterCurves(getItemAtIndex)
byCurvesAndCS = Fabrication.Sheets.ByCurvesAndCS(perimeterCurves, contextCoordinateSystem)
getPolyCurveIndexAsRow_2 = Fabrication.Sheets.GetPolyCurveIndexAsRow(byCurvesAndCS, getTriangleRowIndexBySpline, number, mul)
flatten_2 = List.Flatten(list=getPolyCurveIndexAsRow_2, amt=number_2)
string_2 = StringInput("SHAPES")
number_4 = DoubleInput(3)
addPolyCurvesAsArcsLines_2 = Utilities.ExportToDXF.AddPolyCurvesAsArcsLines(addPolyCurvesAsArcsLines, flatten_2, string_2, number_4)
number_5 = DoubleInput(1)
code_block_3 = CodeBlock { inchtoft(1/16); }
code_block_4 = CodeBlock { inchtoft(11/16); }
placeHoles = TriangleRigging.Triangle.PlaceHoles(getItemAtIndex, number_5, code_block_3, code_block_4)
byCirclesAndCS = Fabrication.Sheets.ByCirclesAndCS(placeHoles, contextCoordinateSystem)
getCircleIndexAsRow = Fabrication.Sheets.GetCircleIndexAsRow(byCirclesAndCS, getTriangleRowIndexBySpline, number, mul)
flatten_3 = List.Flatten(list=getCircleIndexAsRow, amt=number_2)
string_3 = StringInput("HOLES")
number_6 = DoubleInput(2)
addCircles = Utilities.ExportToDXF.AddCircles(addPolyCurvesAsArcsLines_2, flatten_3, string_3, number_6)
string_4 = StringInput("C:\Users\be'cause we can\Documents\GitHub\BecauseWeDynamo\sample\TriangleRigging\")
string_5 = StringInput("sampleSheets")
concat = String.Concat(string_4, string_5)
writeFile = Utilities.ExportToDXF.WriteFile(addCircles, concat)
code_block_5 = CodeBlock()
# ---------- code_block_5.designscript (6 lines) ----------
def numRows(input) {
 return = 0..input-2;
};
def inchtoft(dimInches) {
 return = dimInches/12;
};
# ----------------------------------------
