# Dynamo graph sampleExportEdgeLabel.dyn (Dynamo 0.8.2.1601)

family_types = FamilyTypes("Triangle Rig:Solid")
all_elements_of_family_type = ElementsOfFamilyType(family_types)
geometry = Element.Geometry(all_elements_of_family_type)
locations = AdaptiveComponent.Locations(all_elements_of_family_type)
element_types = ElementTypes("CurveElement")
all_elements_of_type = ElementsOfType(element_types)
curve = CurveElement.Curve(all_elements_of_type)
select_model_element = DSModelElementSelection()  # 1 picked in the model
point = ReferencePoint.Point(select_model_element)
select_model_elements = DSModelElementsSelection()  # 1 picked in the model
point_2 = ReferencePoint.Point(select_model_elements)
select_model_element_2 = DSModelElementSelection()  # 1 picked in the model
point_3 = ReferencePoint.Point(select_model_element_2)
select_model_element_3 = DSModelElementSelection()  # 1 picked in the model
point_4 = ReferencePoint.Point(select_model_element_3)
create = List.Create(point, point_2, point_3, point_4)
byCurvesAndPoints = Fabrication.TriangleSpline.ByCurvesAndPoints(curve, create)
getSplines = Fabrication.TriangleSpline.GetSplines(byCurvesAndPoints)
bySolidsPointsPoints = Fabrication.TriangleRigging.BySolidsPointsPoints(geometry, locations, getSplines)
triangles = Fabrication.TriangleRigging.Triangles(bySolidsPointsPoints)
getSortedTriangleIndicesByName = Fabrication.TriangleRigging.GetSortedTriangleIndicesByName(bySolidsPointsPoints)
getItemAtIndex = List.GetItemAtIndex(list=triangles, index=getSortedTriangleIndicesByName)
number = DoubleInput(1)
number_2 = DoubleInput(12)
number_3 = DoubleInput(4)
mul = number_2 * number_3
div = number / mul
getEdgeLabels = Fabrication.Triangle.GetEdgeLabels(getItemAtIndex, div)
string = StringInput("C:\Users\be'cause we can\Documents\GitHub\BecauseWeDynamo\sample\TriangleRiggingSmall\sampleOutputLabels.dxf")
byPolyCurves = Utilities.ExportCurvesAsLinesToDXF.ByPolyCurves(getEdgeLabels, string)
